% Simulink data dictionary asbCubeSatModelData.sldd

CubeSatTimeStep = 1
gains = struct(Kp=5.5e-5, Ki=0, Kd=0.017)
vehicle = struct(mass=1, inertia=[1 0 0; 0 1 0; 0 0 1])

StatesOutBus = Simulink.Bus()
  utc_JD: double
  X_ecef: double[3]
  V_ecef: double[3]
  X_eci: double[3]
  V_eci: double[3]
  q_ecef2b: double[4]
  q_eci2b: double[4]
  Euler: double[3]
  LatLonAlt: double[3]
  SunAngle: double
  SunInView: boolean

ACSOutBus = Simulink.Bus()
  AttitudeError: AttitudeErrorBus
  TorqueCmds: double[3]
  cmd_q_b2tgt: double[4]
  NavMode: double

FCSOutBus = Simulink.Bus()
  ACSOut: ACSOutBus

AttitudeErrorBus = Simulink.Bus()
  Roll: double
  Pitch: double
  Yaw: double

EnvBus = Simulink.Bus()
  envAccel_ecef: double[3]
  envForces_body: double[3]
  envTorques_body: double[3]
  x_sun_eci: double[3]
  earthAngRate: double[3]

initCond = struct(
  simStartDate=struct(JD=2458488, dateVector=[2019 1 4 12 0 0]),
  CoordEpoch=struct(JD=2451545, dateVector=[2000 1 1 12 0 0]),
  OrbitalElements=struct(
    semiMajorAxis=6878137,
    eccentricity=0.0001,
    inclination=51.6,
    RAAN=95.2562,
    argumentOfPerigee=93.4872,
    trueAnomoly=302.9234,
    trueLongitude=0,
    argumentOfLatititude=0,
    longitudeOfPerigee=0),
  r_eci=[-3032191 5279537 3199365],
  v_eci=[-3375.419 -4848.969 4801.266],
  r_ecef=[-5844951 -1714768 3193704],
  v_ecef=[3794.669 -4000.915 4795.252],
  lla=[27.81521 -163.6496 504253.6],
  v_ned=[5414.702 4907.352 -13.24425],
  uvw=[6142.234 2879.551 -2717.059],
  euler=[33.9 -5.91 9.88],
  pqr=[0 0 0])